# Grasshopper definition addition example.gh (Grasshopper 1.0.7)

a = GetInteger(AtLeast=1, AtMost=1, Maximum=2147483647, Minimum=-2147483648, Prompt="a", TreeAccess=True)
b = GetInteger(AtLeast=1, AtMost=1, Maximum=2147483647, Minimum=-2147483648, TreeAccess=False)
mass_addition = MassAddition(Input=a)  # -> Result, PartialResults
addition = Addition(A=mass_addition.Result, B=b)
context_print = ContextPrint(Text=addition)
