# Grasshopper definition hops example.gh (Grasshopper 1.0.7)
# plug-ins: Hops, MetaHopper

panel = Panel("""5 
10 
24 
6""")
relative_path = RelativePath(Path="Artifacts\addition example.gh")
hops = Hops(
    _Path=relative_path,
    A=panel,
    B=Slider(3, range=0..10),
    CacheResultsInMemory=True,
    CacheSolveResults=True,
    RemoteDefinitionLocation="C:\Users\wvollink\source\repos\aectech-2024-kpf-ttcore-worskhop\Artifacts\addition example.gh",
    RemoteSolveVersion=(0, 1, 0),
    ShowInput_Enabled=False,
    ShowInput_Path=True,
    SynchronousSolve=True)
